# Grasshopper definition gh_script.gh (Grasshopper 1.0.8)

unit_z = UnitZ(Factor=Slider(2, range=0..10))
unit_z_2 = UnitZ(Factor=Slider(3, range=0..10))
settings_speed = SettingsSpeed()
wallcrv = Curve([<curve referenced from the Rhino model> x38])
wallcrv_2 = Curve([<curve referenced from the Rhino model> x37])
doorcrv = Curve([<curve referenced from the Rhino model> x9])
floorsrf = Surface(<surface referenced from the Rhino model>)
floorsrf_2 = Surface(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)
staircrv = Curve(<curve referenced from the Rhino model>)
floorsrf_3 = Surface(<surface referenced from the Rhino model>)
wallcrv_3 = Curve([<curve referenced from the Rhino model> x35])
doorcrv_2 = Curve([<curve referenced from the Rhino model> x5])
staircrv_2 = Curve([<curve referenced from the Rhino model> x2])
doorcrv_3 = Curve([<curve referenced from the Rhino model> x10])
staircrv_3 = Curve(<curve referenced from the Rhino model>)
entwine = Entwine(Branch00=wallcrv, Branch01=wallcrv_3, Branch02=wallcrv_2, FlattenInputs=True)  # -> simplify(Result)
entwine_2 = Entwine(Branch00=floorsrf, Branch01=floorsrf_3, Branch02=floorsrf_2, FlattenInputs=True)  # -> simplify(Result)
entwine_3 = Entwine(Branch00=staircrv, Branch01=staircrv_2, Branch02=staircrv_3, FlattenInputs=True)
entwine_4 = Entwine(Branch00=doorcrv, Branch01=doorcrv_2, Branch02=doorcrv_3, FlattenInputs=True)
extrude = Extrude(Base=entwine, Direction=unit_z_2)
surface_split = SurfaceSplit(Surface=entwine_2, Curves=entwine)
boundary_surfaces = BoundarySurfaces(Edges=entwine_3)
extrude_2 = Extrude(Base=entwine_4, Direction=unit_z)
extrude_3 = Extrude(Base=surface_split, Direction=unit_z_2)
mesh_brep = MeshBrep(Brep=extrude_3, Settings=settings_speed)
mesh_brep_2 = MeshBrep(Brep=extrude, Settings=settings_speed)
param_viewer = ParamViewer(entwine_2)
merge = Merge(Data1=boundary_surfaces, Data2=extrude_2)
mesh_brep_3 = MeshBrep(Brep=merge, Settings=settings_speed)
rooms = Mesh(mesh_brep)
walls = Mesh(mesh_brep_2)
apertures = Mesh(mesh_brep_3)
panel = Panel(entwine)
